# Grasshopper definition FEM.gh (Grasshopper 1.0.7)
# plug-ins: Karamba3D, Kangaroo Components

file = ReadFile(File="C:\AIStructureGenerator\webtool\ghBackend\media\Default\input_FEM.txt", PerLineParse=True)
item = ListItem(List=file, Index=0, Wrap=True)
split = TextSplit(Text=item, Separators="[")
split_2 = TextSplit(Text=split, Separators="]")  # -> flatten(Result)
item_2 = ListItem(List=split_2, Index=1, Wrap=True)
split_3 = TextSplit(Text=item_2, Separators=",")
shift = ShiftList(List=split_3, Shift=1, Wrap=False)
num = Number(shift)
item_3 = ListItem(List=num, Index=0, Wrap=True)
multiplication = Multiplication(A=item_3, B=2)
addition = Addition(A=multiplication, B=1)
addition_2 = Addition(A=addition, B=1)
item_4 = ListItem(List=num, Index=addition, Wrap=True)
shift_2 = ShiftList(List=num, Shift=addition_2, Wrap=False)
dom = ConstructDomain(DomainStart=1, DomainEnd=multiplication)
item_5 = ListItem(List=num, Index=-3, Wrap=True)  # -> Item, Item1, Item2
subset = SubList(List=num, Domain=dom, Wrap=True)  # -> List, Index
shift_3 = ShiftList(List=shift_2, Shift=-3, Wrap=False)
cull = CullPattern(List=shift_3, CullPattern=[True, True, False, False, False])
cull_2 = CullPattern(List=shift_3, CullPattern=[False, False, True, True, False])
cull_3 = CullPattern(List=shift_3, CullPattern=[False, False, False, False, True])
division = Division(A=subset.List, B=500)
dispatch = Dispatch(List=cull, DispatchPattern=[True, False])  # -> ListA, ListB
dispatch_2 = Dispatch(List=cull_2, DispatchPattern=[True, False])  # -> ListA, ListB
dispatch_3 = Dispatch(List=division, DispatchPattern=[True, False])  # -> ListA, ListB
pt = ConstructPoint(XCoordinate=dispatch.ListA, YCoordinate=dispatch.ListB, ZCoordinate=0)
pt_2 = ConstructPoint(XCoordinate=dispatch_2.ListA, YCoordinate=dispatch_2.ListB, ZCoordinate=0)
pt_3 = ConstructPoint(XCoordinate=dispatch_3.ListA, YCoordinate=dispatch_3.ListB, ZCoordinate=0)
equals = Equality(FirstNumber=cull_3, SecondNumber=-1)  # -> Equality, Inequality
ln = Line(StartPoint=pt, EndPoint=pt_2)
pline = PolyLine(Vertices=pt_3, Closed=True)
cull_4 = CullPattern(List=ln, CullPattern=equals.Inequality)
cull_5 = CullPattern(List=cull_3, CullPattern=equals.Inequality)
scale = Scale(Geometry=pline, Center=Point(0, 0, 0), Factor=3000)  # -> Geometry, Transform
dom_2 = ConstructDomain(DomainStart=item_5.Item1, DomainEnd=item_5.Item2)
remap = RemapNumbers(Value=cull_5, Source="0 to 1", Target=dom_2)  # -> Mapped, Clipped

matselect = MaterialSelectionKaramba3D(menu=[dropdown(1), dropdown(1)])
matselect_2 = MaterialSelectionKaramba3D(menu=[dropdown(2), dropdown(1)])
matselect_3 = MaterialSelectionKaramba3D(menu=[dropdown(7), dropdown(1)])
matselect_4 = MaterialSelectionKaramba3D(menu=[dropdown(6), dropdown(1)])
merge = Merge(Data1=matselect, Data2=matselect_2, Data3=matselect_3, Data4=matselect_4)
num_2 = Number(remap.Mapped)
crv = Curve(scale.Geometry)
crv_2 = Curve(cull_4)
item_6 = ListItem(List=merge, Index=item_5.Item, Wrap=True)  # -> Item, Item1, Item2
scale_2 = Scale(Geometry=crv, Center=Point(0, 0, 0), Factor=0.001)  # -> Geometry, Transform
multiplication_2 = Multiplication(A=num_2, B=0.1)
explode = Explode(Curve=scale_2.Geometry, Recursive=True)  # -> Segments, Vertices
scale_3 = Scale(Geometry=crv_2, Center=Point(0, 0, 0), Factor=0.001)  # -> Geometry, Transform
item_7 = ListItem(List=explode.Segments, Index=-1, Wrap=True)
multiplication_3 = Multiplication(A=num_2, B=0.001)
multiplication_4 = Multiplication(A=multiplication_2, B=2)
crv_3 = Curve(scale_3.Geometry)
end = EndPoints(Curve=crv_3)  # -> Start, End
merge_2 = Merge(Data1=end.Start, Data2=end.End)
sqr = Square(Value=multiplication_3)
duppt = RemoveDuplicatePts(Points=merge_2, Tolerance=0.01)  # -> flatten(UniquePoints)
hull = ConvexHull(Points=duppt, Plane=PlaneXY(0, 0, 0))  # -> Hull, HullZ, Indices
explode_2 = Explode(Curve=hull.Hull, Recursive=True)  # -> Segments, Vertices
crv_cp = CurveClosestPoint(Point=duppt, Curve=item_7)  # -> Point, Parameter, Distance
len = Length(Curve=crv_3)
graft = GraftTree(Tree=explode_2.Vertices, IncludeEmptyLists=True, IncludeNullItems=True)
multiplication_5 = Multiplication(A=sqr, B=3.141592654)
smaller = SmallerThan(FirstNumber=crv_cp.Distance, SecondNumber=0.03)  # -> SmallerThan, OrEqualTo
sort = SortList(Keys=crv_cp.Distance, ValuesA=duppt)  # -> Keys, ValuesA
panel = Panel("""7.85
0.6
2.5
2.7""")
multiplication_6 = Multiplication(A=multiplication_5, B=len)
cull_6 = CullPattern(List=duppt, CullPattern=smaller.SmallerThan)
item_8 = ListItem(List=sort.ValuesA, Index=0, Wrap=True)
ma = MassAddition(Input=multiplication_6)  # -> Result, PartialResults
cir = Circle(Plane=cull_6, Radius=0.1)
item_9 = ListItem(List=panel, Index=0, Wrap=True)  # -> Item, Item1, Item2
merge_3 = Merge(Data1=item_8, Data2=cull_6)  # -> flatten(Result)
duppt_2 = RemoveDuplicatePts(Points=merge_3, Tolerance=0.01)
multiplication_7 = Multiplication(A=ma.Result, B=item_9.Item)
multiplication_8 = Multiplication(A=multiplication_7, B=9.8)
neg = Negative(Value=multiplication_8)
division_2 = Division(A=neg, B=2)
pt_4 = Point([Point(3.513471139, 4.020378454, 0), Point(3.455508526, 3.852988787, 0)])
pt_5 = Point([Point(41.96900722, 2.36208844, 0), Point(41.91511208, 2.228514774, 0)])
Z = UnitZ(Factor=division_2)
settings = SettingsKaramba3D(menu=[dropdown(0)])  # -> AllSettings, GenericOutput
pt_6 = Point(pt_4)
Z_2 = UnitZ(Factor="-9.8067e-5")
loads = LoadsKaramba3D(Vector=Vector(0, 0, -1), LCase="0", mode="Gravity")
loads_2 = LoadsKaramba3D(ForceVector=Z_2, Local=False, PosInd=pt_6, mode="Point")
load = LoadKaramba3D(flatten(loads))

# ---- group: Reference Geometry
pt_7 = Point(duppt_2)

crv_4 = Curve(crv_3)

# ----
dist = Distance(PointA=graft, PointB=pt_7)
sort_2 = SortList(Keys=dist)  # -> Keys, ValuesA
item_10 = ListItem(List=sort_2.Keys, Index=-1, Wrap=True)  # -> flatten(Item)
sort_3 = SortList(Keys=item_10, ValuesA=explode_2.Vertices)  # -> Keys, ValuesA
item_11 = ListItem(List=sort_3.Keys, Index=-1, Wrap=True)
item_12 = ListItem(List=sort_3.ValuesA, Index=-1, Wrap=True)
pt_8 = Point(item_12)
lng = ListLength(List=crv_4)
series = Series(Start=0, Step=1, Count=lng)
txt = Text(series)
graft_2 = GraftTree(Tree=txt, IncludeEmptyLists=True, IncludeNullItems=True)
ins = InsertItems(List=graft_2, Item="A", Indices=0, Wrap=True)
join = TextJoin(Text=ins)  # -> flatten(Result)
cross_section = CrossSectionKaramba3D(
    FamilyNameOfCrossSection="DefaultCroSec",
    ElementIdentifier=join,
    Material=item_6.Item,
    Diameter_cm=multiplication_4,
    WallThickness_cm=multiplication_2,
    mode="Circular Hollow")
loads_3 = LoadsKaramba3D(ForceVector=Z, Local=False, PosInd=pt_8, mode="Point")
load_2 = LoadKaramba3D(flatten(loads_3))
multiplication_9 = Multiplication(A=item_11, B=1000)

# ---- group: Define Elements
linetobeam = LineToBeamKaramba3D(
    Line=crv_4,
    Identifier=join,
    CrossSection=cross_section,
    New=True,
    Remove=True,
    LimitDistance_m=0.005,
    Bending=Toggle(True))  # -> Element, Points, Info

# ---- group: Reference Geometry
pt_9 = Point(linetobeam.Points)

# ---- group: Define Supports
fsim = FindSimilarMember(Data=pt_7, Set=linetobeam.Points)  # -> Hit, Index
cull_i = CullIndex(List=linetobeam.Points, Indices=fsim.Index, Wrap=True)
supp = SupportKaramba(PosInd=pt_7, menu=[buttons(on, on, on, on, on, on)])
supp_2 = SupportKaramba(PosInd=cull_i, menu=[buttons(off, on, off, on, off, on)])
support = SupportKaramba(flatten(supp))

# ---- group: Assemble Model
assemble = AssembleModelKaramba(
    Elem=linetobeam.Element,
    Support=support,
    Load=load,
    CrossSection=cross_section,
    Material=item_6.Item,
    LimitDistance_m=0.005)  # -> Model, Info, Mass_kg, CenterOfGravity

assemble_2 = AssembleModelKaramba(Elem=linetobeam.Element, Support=support, Load=load_2, LimitDistance_m=0.005)  # -> Model, Info, Mass_kg, CenterOfGravity

# ---- group: Analyze Model
analyze = AnalyzeKaramba3D(Model=assemble.Model)  # -> CalculatedModel, MaximumDisplacement_cm, ResultingForceOfGravity_kN, ElasticEnergy_kNm
displacement = Panel(analyze.MaximumDisplacement_cm)

analyze_2 = AnalyzeKaramba3D(Model=assemble_2.Model)  # -> CalculatedModel, MaximumDisplacement_cm, ResultingForceOfGravity_kN, ElasticEnergy_kNm
displacement_2 = Panel(analyze_2.MaximumDisplacement_cm)

# ---- group: View Results
modelview = ModelViewKaramba3D(Model=analyze.CalculatedModel, LoadCaseFactorsForLinearSuperposition=1, IndexOfVisibleLoadcase=-1)  # -> Model, DeformedMesh, DeformedAxes, DeformedModel
beamview = BeamViewKaramba3D(Model=modelview.Model)  # -> Model, MeshesOfRenderedBeams, DeformedBeamAxes, LegendColors, LegendTags
legend = Legend(Colour=beamview.LegendColors, Tags=beamview.LegendTags, LegendType=1)

modelview_2 = ModelViewKaramba3D(Model=analyze_2.CalculatedModel, LoadCaseFactorsForLinearSuperposition=1, IndexOfVisibleLoadcase=-1)  # -> Model, DeformedMesh, DeformedAxes, DeformedModel
beamview_2 = BeamViewKaramba3D(Model=modelview_2.Model)  # -> Model, MeshesOfRenderedBeams, DeformedBeamAxes, LegendColors, LegendTags
legend_2 = Legend(Colour=beamview_2.LegendColors, Tags=beamview_2.LegendTags, LegendType=1)

# ----
panel_2 = Panel(linetobeam.Points)
crv_5 = Curve(modelview.DeformedAxes)
crv_6 = Curve(modelview_2.DeformedAxes)
scale_4 = Scale(Geometry=crv_5, Center=Point(0, 0, 0), Factor=1000)  # -> Geometry, Transform
scale_5 = Scale(Geometry=crv_6, Center=Point(0, 0, 0), Factor=1000)  # -> Geometry, Transform
crv_7 = Curve(scale_5.Geometry)
end_2 = EndPoints(Curve=scale_4.Geometry)  # -> Start, End
lng_2 = ListLength(List=scale_4.Geometry)
end_3 = EndPoints(Curve=crv_7)  # -> Start, End
ln_2 = Line(StartPoint=end_2.Start, EndPoint=end_2.End)
lng_3 = ListLength(List=crv_7)
ln_3 = Line(StartPoint=end_3.Start, EndPoint=end_3.End)
end_4 = EndPoints(Curve=ln_2)  # -> Start, End
end_5 = EndPoints(Curve=ln_3)  # -> Start, End
pdecon = Deconstruct(Point=end_4.Start)  # -> XComponent, YComponent, ZComponent
pdecon_2 = Deconstruct(Point=end_4.End)  # -> XComponent, YComponent, ZComponent
pdecon_3 = Deconstruct(Point=end_5.Start)  # -> XComponent, YComponent, ZComponent
pdecon_4 = Deconstruct(Point=end_5.End)  # -> XComponent, YComponent, ZComponent
graft_3 = GraftTree(Tree=pdecon_2.ZComponent, IncludeEmptyLists=True, IncludeNullItems=True)
graft_4 = GraftTree(Tree=pdecon.ZComponent, IncludeEmptyLists=True, IncludeNullItems=True)
graft_5 = GraftTree(Tree=pdecon_4.ZComponent, IncludeEmptyLists=True, IncludeNullItems=True)
graft_6 = GraftTree(Tree=pdecon_3.ZComponent, IncludeEmptyLists=True, IncludeNullItems=True)
merge_4 = Merge(Data1=graft_4, Data2=graft_3)
merge_5 = Merge(Data1=graft_6, Data2=graft_5)
sort_4 = SortList(Keys=merge_4)  # -> Keys, ValuesA
sort_5 = SortList(Keys=merge_5)  # -> Keys, ValuesA
item_13 = ListItem(List=sort_4.Keys, Index=1, Wrap=True)  # -> flatten(Item)
item_14 = ListItem(List=sort_5.Keys, Index=1, Wrap=True)  # -> flatten(Item)
bnd = Bounds(Numbers=item_13)
bnd_2 = Bounds(Numbers=item_14)
dedomain = DeconstructDomain(Domain=bnd)  # -> Start, End
gradient = Gradient(
    LowerLimit=dedomain.Start,
    UpperLimit=dedomain.End,
    Parameter=item_13,
    stops=[0: RGB(234, 38, 0), 0.25: RGB(234, 126, 0), 0.5: RGB(254, 244, 84), 0.75: RGB(173, 203, 249), 1: RGB(75, 107, 169)])
dedomain_2 = DeconstructDomain(Domain=bnd_2)  # -> Start, End
gradient_2 = Gradient(
    LowerLimit=dedomain_2.Start,
    UpperLimit=dedomain_2.End,
    Parameter=item_14,
    stops=[0: RGB(234, 38, 0), 0.25: RGB(234, 126, 0), 0.5: RGB(254, 244, 84), 0.75: RGB(173, 203, 249), 1: RGB(75, 107, 169)])
argb = SplitARGB(Colour=gradient)  # -> Alpha, Red, Green, Blue
argb_2 = SplitARGB(Colour=gradient_2)  # -> Alpha, Red, Green, Blue
multiplication_10 = Multiplication(A=argb.Red, B=255)
multiplication_11 = Multiplication(A=argb.Green, B=255)
multiplication_12 = Multiplication(A=argb.Blue, B=255)
multiplication_13 = Multiplication(A=argb_2.Red, B=255)
multiplication_14 = Multiplication(A=argb_2.Green, B=255)
multiplication_15 = Multiplication(A=argb_2.Blue, B=255)
merge_6 = Merge(
    Data1=simplify(graft(pdecon.XComponent)),
    Data2=simplify(graft(pdecon.YComponent)),
    Data3=simplify(graft(pdecon.ZComponent)),
    Data4=simplify(graft(pdecon_2.XComponent)),
    Data5=simplify(graft(pdecon_2.YComponent)),
    Data6=simplify(graft(pdecon_2.ZComponent)),
    Data7=simplify(graft(multiplication_10)),
    Data8=simplify(graft(multiplication_11)),
    Data9=simplify(graft(multiplication_12)))
merge_7 = Merge(Data1=flatten(lng_2), Data2=flatten(dedomain.End), Data3=flatten(dedomain.Start), Data4=flatten(multiplication_9))
merge_8 = Merge(
    Data1=simplify(graft(pdecon_3.XComponent)),
    Data2=simplify(graft(pdecon_3.YComponent)),
    Data3=simplify(graft(pdecon_3.ZComponent)),
    Data4=simplify(graft(pdecon_4.XComponent)),
    Data5=simplify(graft(pdecon_4.YComponent)),
    Data6=simplify(graft(pdecon_4.ZComponent)),
    Data7=simplify(graft(multiplication_13)),
    Data8=simplify(graft(multiplication_14)),
    Data9=simplify(graft(multiplication_15)))
merge_9 = Merge(Data1=flatten(lng_3), Data2=flatten(dedomain_2.End), Data3=flatten(dedomain_2.Start), Data4=flatten(multiplication_9))
join_2 = TextJoin(Text=merge_7, Join=",")  # -> flatten(Result)
join_3 = TextJoin(Text=merge_6, Join=",")  # -> flatten(Result)
join_4 = TextJoin(Text=merge_9, Join=",")  # -> flatten(Result)
join_5 = TextJoin(Text=merge_8, Join=",")  # -> flatten(Result)
merge_10 = Merge(Data1=join_2, Data2=join_3)
merge_11 = Merge(Data1=join_4, Data2=join_5)
merge_12 = Merge(Data1=merge_10, Data2=merge_11)

# ---- group: Check Beam Internal Forces
b_forces = BeamForcesKaramba(AnalyzedModel=analyze.CalculatedModel, LCase=-1, MaximumDistanceBetweenResults_m=-1, NumberOfResultsPerBeamElement="3")  # -> AnalyzedModel, NormalForce_kN, ShearForceVz_kN, ShearForceVy_kN, BendingMomentMt_kNm, BendingMomentMy_kNm, BendingMomentMz_kNm
panel_3 = Panel(b_forces.NormalForce_kN)

# ---- group: Check Beam Displacements
beamdisp = BeamDisplacementsKaramba(AnalyzedModel=analyze.CalculatedModel, LoadCase=-1, MaximumDistanceBetweenResults_ft=-1, NumberOfResultsPerElement="3")  # -> AnalyzedModel, simplify(Translations_ft), Rotations_rad
panel_4 = Panel(beamdisp.Translations_ft)

# ---- group: Check Beam Internal Forces
b_forces_2 = BeamForcesKaramba(AnalyzedModel=analyze_2.CalculatedModel, LCase=-1, MaximumDistanceBetweenResults_m=-1, NumberOfResultsPerBeamElement="3")  # -> AnalyzedModel, NormalForce_kN, ShearForceVz_kN, ShearForceVy_kN, BendingMomentMt_kNm, BendingMomentMy_kNm, BendingMomentMz_kNm
panel_5 = Panel(b_forces_2.NormalForce_kN)

# ---- group: Check Beam Displacements
beamdisp_2 = BeamDisplacementsKaramba(AnalyzedModel=analyze_2.CalculatedModel, LoadCase=-1, MaximumDistanceBetweenResults_ft=-1, NumberOfResultsPerElement="3")  # -> AnalyzedModel, simplify(Translations_ft), Rotations_rad
panel_6 = Panel(beamdisp_2.Translations_ft)

# ----
txt_2 = Text(merge_12)
python = FileCreator(name="outputfem", ext="txt", lines=txt_2, write=Toggle(True))  # inputs lines: list, write: Boolean
# ---------- python: Python ----------
"""
Creates a file with a given ndame and extension.
    Inputs:
        name: Desired file name.
        ext: Desired file extension.
        lines: Text to write.
        write: Set to True to write.
"""

# Stephen P. Maher /  2015

ghenv.Component.Name = "File Creator"

import Grasshopper as gh
import os

gh_path = ghdoc.Path # Get GH file path
file = os.path.dirname(os.path.realpath(gh_path)) # Get GH file directory to save to

if "." not in ext: ext = "." + ext
else: pass

#if os.path.exists(file) == False: # Test if file already exists; if it doesn't, proceed
file = name + ext # Set file name and extension
#if os.path.exists(file) == True: # If it does exists, follow the next steps
#    file_count = len([f for f in os.walk(".").next()[2] if f[-4:] == ext]) # Find all files with the same extension
#    file = name + "_" + str(file_count) + ext # Add the number to the new file name as a differentiator

if write:
    filePath = open(file, "w") # Open the file
    for line in lines: # Iterate through lines
        filePath.write(line + "\n") # Write separate lines
    filePath.close() # Close the file
else:
    msg = "Set 'write' to True."
    ghenv.Component.AddRuntimeMessage(gh.Kernel.GH_RuntimeMessageLevel.Warning, msg)
# ---------- end python ----------
lng_4 = ListLength(List=txt_2)
division_3 = Division(A=lng_4, B=lng_4)
txt_3 = Text(division_3)
python_2 = FileCreator(name="done_FEM", ext="txt", lines=txt_3, write=Toggle(True))  # inputs lines: list, write: Boolean; same code as python
